# Grasshopper definition AutoPanel2.gh (Grasshopper 1.0.7)
# plug-ins: Human, EleFront, ScriptParasite, MetaHopper, Heteroptera

layertable = LayerTable(Update=True, AutoUpdate=True)  # -> Layers, FullLayerPaths, LayerColors, Linetypes, MaterialNames, Visible, PrintWidth, PrintColor
# Da Rhino assicurarsi di avere i layer così ordinati:
# -------------------
# dir-border-h
# dir-border-v
# 
# dir-h-x.x
# ...
# dir-v-x.x
# ...
# -------------------
# i primi due sono DUE LINEE che determinano i bordi dell'area da pannellare. I bordi avranno anch'essi una fuga e andranno ridisegnati nei layer delle fughe
# 
# I layer seguenti sono tutte le fughe centrate che il codice utilizza per creare i pannelli
# -------------------
# obs-[...]
# -------------------
# gli ostacoli
python = GhPythonScript(x=layertable.Layers)  # -> a; inputs x: list
# ---------- python: Python ----------
__author__ = "riccardo"
__version__ = "2023.02.16"

import rhinoscriptsyntax as rs

list = []

for i in x:
    if (i.split('-')[0] == 'dir'):
        list.append(i)

a = list
# ---------- end python ----------
panel = Panel(python)

reflay = ReferenceByLayer(LayerName="dir-border-h")
reflay_2 = ReferenceByLayer(LayerName="dir-border-v")
reflay_3 = ReferenceByLayer(LayerName="dir-h-2.2")
reflay_4 = ReferenceByLayer(LayerName="dir-h-8.8")
reflay_5 = ReferenceByLayer(LayerName="dir-v-8.8")

reflay_6 = ReferenceByLayer(LayerName="obs-windows")

# ---- group: BASE VECTOR
end = EndPoints(Curve=reflay)  # -> Start, End
vec2pt = Vector2Pt(PointA=end.Start, PointB=end.End, Unitize=False)  # -> Vector, Length

# ---- group: HEIGHT VECTOR
end_2 = EndPoints(Curve=reflay_2)  # -> Start, End
vec2pt_2 = Vector2Pt(PointA=end_2.Start, PointB=end_2.End, Unitize=False)  # -> Vector, Length

# ---- group: Origin
end_3 = EndPoints(Curve=reflay)  # -> Start, End
pt = Point(end_3.Start)

# ----
entwine = Entwine(
    Branch00="dir-border-h",
    Branch01="dir-border-v",
    Branch02="dir-h-2.2",
    Branch03="dir-h-8.8",
    Branch04="dir-v-8.8",
    FlattenInputs=True)
entwine_2 = Entwine(Branch00=reflay, Branch01=reflay_2, Branch02=reflay_3, Branch03=reflay_4, Branch04=reflay_5, FlattenInputs=True)
merge = Merge(Data1=entwine, Data2=entwine_2)  # -> simplify(Result)

# ---- group: GENERATOR
c_script = CSharpScript(x=merge, y=reflay_6)  # -> pl, names, archive, freeTag; inputs x: tree, y: list of Polyline
# ---------- c_script: C# usings ----------
using Rhino.Geometry.Intersect;
using System.Linq;
using Rhino.FileIO;
# ---------- c_script: C# ----------
    grid = new Grid(x, y);
    panelC41s = grid.panels;

    pl = grid.Plines(panelC41s);
    names = grid.NameTags(panelC41s);
    archive = Archive(panelC41s);
    freeTag = grid.FreeTag(panelC41s);
# ---------- c_script: C# additional code ----------
  // fields
  public Grid grid;
  public List<PanelC41> panelC41s;

  public List<string> archive;

  public class Grid
  {
    public DataTree<object> param;
    List<Polyline> obs;
    public List<double> xCoordinates;
    public List<double> yCoordinates;

    public List<PanelC41> panels;
    public List<Point3d> pts;

    public Grid(DataTree<object> x, List<Polyline> y)
    {
      param = x;
      obs = y;

      OrderLines(param);

      pts = new List<Point3d>();

      panels = Panels(xCoordinates, yCoordinates);
    }

    public void OrderLines(DataTree<object> param)
    {
      List<double> xtmp = new List<double>();
      List<double> ytmp = new List<double>();

      for (int i = 2; i < param.BranchCount; i++)
      {
        int fuga = (int) Convert.ToInt64(param.Branch(i)[0].ToString().Split('-')[2].ToString().Split('.')[0]);
        string dir = param.Branch(i)[0].ToString().Split('-')[1];

        List<double> tmp = new List<double>();

        if (dir == "h")
        {
          for (int j = 1; j < param.Branch(i).Count; j++)
          {
            PolylineCurve tmpPl = (PolylineCurve) param.Branch(i)[j];
            tmp.Add(tmpPl.PointAt(0).Y - fuga);
            tmp.Add(tmpPl.PointAt(0).Y + fuga);
          }

          ytmp.AddRange(tmp);
        }

        else if (dir == "v")
        {
          for (int j = 1; j < param.Branch(i).Count; j++)
          {
            PolylineCurve tmpPl = (PolylineCurve) param.Branch(i)[j];
            tmp.Add(tmpPl.PointAt(0).X - fuga);
            tmp.Add(tmpPl.PointAt(0).X + fuga);
          }

          xtmp.AddRange(tmp);
        }
      }

      xtmp.Sort();
      ytmp.Sort();

      xCoordinates = xtmp;
      yCoordinates = ytmp;

      xCoordinates.RemoveAt(xCoordinates.Count - 1);
      yCoordinates.RemoveAt(yCoordinates.Count - 1);
      xCoordinates.RemoveAt(0);
      yCoordinates.RemoveAt(0);

      //sortedList = pts.OrderBy(point => point.X).ToList();
    }

    public List<PanelC41> Panels(List<double> xCoordinates, List<double> yCoordinates)
    {
      List<PanelC41> panels = new List<PanelC41>();

      for (int i = 0; i < yCoordinates.Count; i += 2)
      {
        for (int j = 0; j < xCoordinates.Count; j += 2)
        {
          var points = new List<Point3d>
            {
              new Point3d(xCoordinates[j], yCoordinates[i], 0),
              new Point3d(xCoordinates[j + 1], yCoordinates[i], 0),
              new Point3d(xCoordinates[j + 1], yCoordinates[i + 1], 0),
              new Point3d(xCoordinates[j], yCoordinates[i + 1], 0),
              new Point3d(xCoordinates[j], yCoordinates[i], 0)
              };

          pts.AddRange(points.GetRange(0, 4));
          panels.Add(new PanelC41(points, obs));
        }
      }

      return panels;
    }

    public List<Polyline> Plines(List<PanelC41> panels)
    {
      List<Polyline> polylines = panels.Select(i => i.pl).ToList();

      return polylines;
    }

    public List<bool> FreeTag(List<PanelC41> panels)
    {
      List<bool> freeTag = panels.Select(i => i.crossed).ToList();

      return freeTag;
    }

    public List<string> NameTags(List<PanelC41> panels)
    {
      List<string> nameTags = panels.Select(i => i.name).ToList();

      return nameTags;
    }
  }

  public class PanelC41
  {
    //fields
    public double width;
    public double height;
    public double borderUp;
    public double borderDown;
    public double hookUp;
    public double hookDown;

    public Polyline pl;
    public bool crossed;
    public string name;

    //Constructor
    public PanelC41(List<Point3d> list, List<Polyline> obs)
    {
      borderUp = 0;
      borderDown = 0;
      hookUp = 0;
      hookDown = 0;

      pl = new Polyline(list);
      Intercept(obs);
      Name();
    }

    public void Intercept(List<Polyline> obs)
    {
      int a = 0;

      for (int i = 0; i < obs.Count; i++)
      {
        a += Intersection.CurveCurve(pl.ToPolylineCurve(), obs[i].ToPolylineCurve(), 0.1, 0.1).Count;
      }

      if (a == 0) crossed = false;
      else crossed = true;
    }

    public void Name()
    {
      width = Math.Round(pl[0].DistanceTo(pl[1]));
      height = Math.Round(pl[1].DistanceTo(pl[2]));
      name = width.ToString() + '-' + height.ToString();
    }
  }

  public List<string> Archive(List<PanelC41> panelC41s)
  {
    List<string> list;
    var orderedPanels = panelC41s.OrderBy(panelC41 => panelC41.width).ThenBy(panelC41 => panelC41.height);

    list = orderedPanels.Select(x => x.name).ToList();

    List<string> arc = new List<string> { list[0] };
    for (int i = 1; i < list.Count; i++)
    {
      if (list[i] != list[i - 1])
      {
        arc.Add(list[i]);
      }
    }

    return arc;
  }
# ---------- end c_script ----------
scriptpar = ScriptParasite(Enable=True, Folder="C:\Users\riccardo\source\repos\GH_Develop\AutoPanel")

# ---- group: WIRE DISPLAY
list = ValueList({"def": 0, "fai": 1, "hid": 2}, selected="hid")
wiredisplay = ControlWireDisplay(WireDisplay=list, AllObjects_Object=[c_script, merge, entwine, entwine_2, layers, qb, area, textbaker, python_2])

# ---- group: OBSTACLE COLORS
cluster = Cluster(x=c_script.freeTag)
geo = Geometry(c_script.pl)
preview = CustomPreview(Geometry=geo, Material=cluster)

# ---- group: ACTIVATE
onoff = EnableDisableObject(Enabled=Toggle(False), AllObjects_Object=[layers, qb, textbaker])

# ----
area = Area(Geometry=c_script.pl)  # -> Area, Centroid
python_2 = GhPythonScript(x=c_script.names)  # -> a
# ---------- python_2: Python ----------
__author__ = "riccardo"
__version__ = "2023.02.21"

import rhinoscriptsyntax as rs

a = '%' + x
# ---------- end python_2 ----------

panel_2 = Panel("BAKING STATION")
bake = Button()
qb = QuickBaker(Geometric=c_script.pl, Attribute=python_2, Bake=False)  # disabled

layers = CreateModifyLayers(LayerName=c_script.archive, DeleteLayer=False, enableFullPath=False)  # -> LayerNames, LayerFullPath; disabled
textbaker = TextBaker(
    Location=area.Centroid,
    Text=c_script.names,
    Size="100",
    Attribute=python_2,
    Justification=4,
    Bake=bake,
    Dot_Text=False,
    Enable_Mask=True,
    On_Screen=False)  # disabled

# ---- group: VIEW
hideshow = HideShowObjectPreview(Visible=Toggle(True), AllObjects_Object=[preview, textbaker])

# ==== cluster Cluster
x = ClusterInput()
python = GhPythonScript(x=x)  # -> a
# ---------- python: Python ----------
__author__ = "riccardo"
__version__ = "2023.02.21"

import rhinoscriptsyntax as rs

if (x == False):
    a = '63,232,232'
else:
    a = '230,37,232'
# ---------- end python ----------
material = CreateMaterial(Diffuse=python, Specular=RGB(255, 255, 255), Emission=RGB(0, 0, 0), Transparency=0, Shine=0)
M = ClusterOutput(material)
